# Grasshopper definition LatticeStructure.gh (Grasshopper 1.0.7)

crv = Curve([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])
crv_2 = Curve([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])
crv_3 = Curve([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])
pt = Point([Point(0, 0, 60), Point(0, 60, 60), Point(60, 60, 60), Point(60, 60, 0), Point(60, 0, 0), Point(0, 0, 0), Point(60, 0, 60), Point(0, 60, 0)])

cluster = Cluster(D=Slider(-5, range=-5..10), crv=crv, crv_3=crv_2, crv_2=crv_3, D_2=Slider(10, range=-5..10), pt=pt)  # -> R, Q, crv_7, R_2, pt_3
# Click to Initialize
button = Button()
vecdiffeqsolver_beta = CSharpScript(
    EdgeLn=cluster.R,
    EdgeMag=cluster.R_2,
    NodePt=cluster.Q,
    ExtForceLn=cluster.crv_7,
    FreeSuppNode=cluster.pt_3,
    iter=Slider(3000, range=0..1000000),
    Deform_Ratio=Slider(0.31, range=0..1),
    SubD=Slider(1, range=0.0001..1),
    WeightVec=Toggle(False),
    Run=button,
    Reference="C:\Users\sycar\AppData\Roaming\Grasshopper\Libraries\VecDiffEqSolverBeta.dll")  # -> out, Nodes, IntForceLns, IntForceMags, ExtForceLns; inputs EdgeLn: list of Line, EdgeMag: list of Double, NodePt: list of Point3d, ExtForceLn: list of Line, DefSuppNode: list of Point3d, FreeSuppNode: list of Point3d, iter: Int32, Deform_Ratio: Double, SubD: Double, WeightVec: Boolean, Run: Boolean
# ---------- vecdiffeqsolver_beta: C# usings ----------
using System.Linq;
using System.Threading.Tasks;
using VecDiffSolver;
# ---------- vecdiffeqsolver_beta: C# ----------
    ///
    ///This is a vector-difference-based equlibrium solver, developed by:
    ///[Yuchi Shen]: Southeast University of Nanjing, School of Architecture
    ///[Pierluigi D'Acunto]: Technical University of Munich, Professorship of Structural Design
    ///<Beta version>
    ///Please make sure the assembly <VecDiffEqSolverBeta.dll> is well attached in the component.
    ///

    #region 0_Global Settings

    ///0.0 Inputs_data
    //ratio： is a form force deforming value ranged from 0~1, where 0.5 means form and force changes in the same weight to get eq;
    //WeightVectorDiff:If true, the program will weight the various difference between the force vectors.This may make the tension-compression combined structure solution better.
    //ImposeEquilibrium:If true, the solution will be imposed to a global equilirbium eventhough the optimization have not get converged. In that case, fake load may appear in the nodes of the structure.
    //tol: The tolerance for the comparing nodes in rhino in a minimal distance.If the modelling accuracy should be larger, then lower the value.
    //threshold: The main loop will stop while the convergence under the threshold.
    //subdivison:The transforming of the form diagram can be subdivided into segments to impove the accuracy of the solving.

    bool WeightVectorDiff = WeightVec;
    bool ImposeEquilibrium = true;
    double tol = 0.0001;
    double threshold = 0.0001;
    double subdivison = SubD;
    double scale = 1.0;

    #endregion

    if(Run)
    {
      #region 1_Data Construction
      //AllSuppIndex:All the support nodes that will not move in the form-finding process; AllSuppIndex contians OptSuppIndex;
      //OptSuppIndex:Certain supports that can be optimized loads in the form-finding process;
      //The difference set of above two are the supports predefined, the same with the loads;

      List<int> AllSuppIndex;
      List<int> OptSuppIndex;
      VecDiffSolver.Data.SupportMatch(NodePt, FreeSuppNode, DefSuppNode, tol, out AllSuppIndex, out OptSuppIndex);

      //LoadOnVertices: a List of Lists( with load vectors applying on the same index vertex)
      List<List<Vector3d>> LoadOnVertices;
      VecDiffSolver.Data.LoadMatch(NodePt, ExtForceLn, tol, out LoadOnVertices);

      //1.1_Construct the matrix of forces in the structure;
      double[,] Matr_force;
      VecDiffSolver.Data.ConstructForceMatrix(NodePt, EdgeLn, EdgeMag, tol, out Matr_force);
      #endregion


      #region 2_MainLoop
      //2 MainLoop
      List<Point3d> Vns = new List<Point3d>(NodePt);
      int Iteration = 0;
      double convergence = double.MaxValue;
      List<double> ratioList = NodePt.Select(p => Deform_Ratio).ToList();

      while(Iteration < iter && convergence >= threshold)
      {
        Iteration++;

        Vector3d[] AVsums;
        if(WeightVectorDiff)
        {
          //Calculate weighted Vertex Force Sum
          Vector3d[,] VecDiffMatrix;
          VecDiffSolver.VecDiff.Weight_VectorDiffOnNodes(Vns, OptSuppIndex, Matr_force, LoadOnVertices, subdivison, tol, out VecDiffMatrix, out AVsums);

          //Update Vertices
          List<Point3d> N_Vertices;
          VecDiffSolver.VecDiff.UpdateVertices(AllSuppIndex, Vns, AVsums, ratioList, Matr_force, LoadOnVertices, tol, out N_Vertices);

          //Update weighted Force Matrix
          VecDiffSolver.VecDiff.Weight_UpdateMatr_force(ref Matr_force, VecDiffMatrix, Vns, N_Vertices, Deform_Ratio, tol);
          Vns = N_Vertices;
        }
        else
        {
          //Calculate Vertex Force Sum
          VecDiffSolver.VecDiff.VectorDiffOnNodes(Vns, OptSuppIndex, Matr_force, LoadOnVertices, subdivison, tol, out AVsums);

          //Update Vertices
          List<Point3d> N_Vertices;
          VecDiffSolver.VecDiff.UpdateVertices(AllSuppIndex, Vns, AVsums, ratioList, Matr_force, LoadOnVertices, tol, out N_Vertices);

          //Update Force Matrix
          VecDiffSolver.VecDiff.UpdateMatr_force(ref Matr_force, AVsums, Vns, N_Vertices, Deform_Ratio, tol);
          Vns = N_Vertices;
        }

        //Check convergence
        convergence = 0.0;
        foreach(Vector3d vec in AVsums)
        {
          convergence += vec.Length;
        }
        if(Iteration == iter || convergence < threshold)
        {
          report = VecDiffSolver.Debug.Report(AVsums, Deform_Ratio, Iteration);
        }
      }

      #endregion


      #region 3_GetSolution
      //Get the solved equilibrium information;
      VecDiffSolver.IO.Solution(Vns, Matr_force, LoadOnVertices, OptSuppIndex, AllSuppIndex, ImposeEquilibrium, tol, scale, out Internal_Ln, out Internal_Force, out External_Ln);
      StrNodes = Vns;
      #endregion
    }

    //Outputs in GH Component
    Nodes = StrNodes;
    IntForceLns = Internal_Ln;
    IntForceMags = Internal_Force;
    ExtForceLns = External_Ln;
    Print(report);
# ---------- vecdiffeqsolver_beta: C# additional code ----------
  List<Point3d>StrNodes;
  List <Line> Internal_Ln;
  List<double> Internal_Force;
  List<Line> External_Ln;
  string report;
# ---------- end vecdiffeqsolver_beta ----------
panel = Panel(vecdiffeqsolver_beta.out)
visualize = Visualize(L=vecdiffeqsolver_beta.IntForceLns, A=vecdiffeqsolver_beta.IntForceMags, G=vecdiffeqsolver_beta.ExtForceLns)

# ==== cluster Visualize
A = ClusterInput()
L = ClusterInput()
larger = LargerThan(FirstNumber=A, SecondNumber=0)  # -> LargerThan, OrEqualTo
dispatch = Dispatch(List=L, DispatchPattern=larger.LargerThan)  # -> ListA, ListB
G = ClusterInput()
preview = CustomPreview(Geometry=dispatch.ListA, Material=ColourSwatch(SwatchColor=RGB(228, 7, 20)))
preview_2 = CustomPreview(Geometry=dispatch.ListB, Material=ColourSwatch(SwatchColor=RGB(5, 120, 191)))
preview_3 = CustomPreview(Geometry=G, Material=ColourSwatch(SwatchColor=RGB(0, 100, 0)))

# ==== cluster Cluster
crv = ClusterInput()
crv_2 = ClusterInput()
crv_3 = ClusterInput()
crv_4 = Curve(crv)
crv_5 = Curve(crv_2)
crv_6 = Curve(crv_3)
D = ClusterInput()
lng = ListLength(List=crv_4)
crv_7 = ClusterOutput(crv_6)
pt = ClusterInput()
dup = DuplicateData(Data=D, Number=lng, Order=True)
D_2 = ClusterInput()
lng_2 = ListLength(List=crv_5)
merge = Merge(Data1=crv_4, Data2=crv_5)
pt_2 = Point(pt)
dup_2 = DuplicateData(Data=D_2, Number=lng_2, Order=True)
merge_2 = Merge(Data1=dup, Data2=dup_2)
R = ClusterOutput(merge)
pt_3 = ClusterOutput(pt_2)
R_2 = ClusterOutput(merge_2)
end = EndPoints(Curve=merge)  # -> Start, End
pt_4 = Point(flatten([end.Start, end.End]))
duppt = RemoveDuplicatePts(Points=pt_4, Tolerance=0.01)
Q = ClusterOutput(duppt)
